# Grasshopper definition L2GH.gh (Grasshopper 1.0.8)

number_slider = Slider(0.5, range=0..1)
number_slider_2 = Slider(3.742, range=0..10)
construct_point = ConstructPoint(XCoordinate=number_slider, YCoordinate=number_slider, ZCoordinate=0)
domain_box = DomainBox(Base=PlaneXY(0, 0, 0), X=number_slider_2, Y=number_slider_2, Z=Slider(10, range=0..10))
# Deconstructs the tower in order to get the sides
deconstruct_brep = DeconstructBrep(Brep=domain_box)  # -> Faces, Edges, Vertices
list_item = ListItem(List=deconstruct_brep.Faces, Index=Slider(4, range=1..6), Wrap=True)
evaluate_surface = EvaluateSurface(Surface=reparameterize(list_item), Point=construct_point)  # -> Point, Normal, UDirection, VDirection, Frame
vector_xyz = VectorXYZ(XComponent=0, YComponent=0, ZComponent=Slider(0.117, range=0..1))  # -> Vector, Length
# Place the points at each ends of the tower
project_point = ProjectPoint(Point=evaluate_surface.Point, Direction=vector_xyz.Vector, Geometry=domain_box)  # -> Point, Index
line = Line(StartPoint=evaluate_surface.Point, EndPoint=project_point.Point)
# the domian of where you want the twist
construct_domain = ConstructDomain(DomainStart=Slider(1, range=0..1), DomainEnd=Slider(0, range=0..1))
# make the line around the axis curve
sub_curve = SubCurve(BaseCurve=line, Domain=construct_domain)
twist = Twist(Geometry=domain_box, Axis=sub_curve, Angle=degrees(Slider(360, range=-180..360)), Infinite=False, Rigid=False)
brep = Brep(twist)
bounding_box = BoundingBox(Content=brep, Plane=PlaneXY(0, 0, 0))  # -> Box, Box_2
box_corners = BoxCorners(Box=bounding_box.Box)  # -> CornerA, CornerB, CornerC, CornerD, CornerE, CornerF, CornerG, CornerH
# *Divide length set to 1 or too many slices
number_slider_3 = Slider(1, range=0..1)
line_2 = Line(StartPoint=box_corners.CornerA, EndPoint=box_corners.CornerE)
# line from bottom left to get the height of the tower
divide_length = DivideLength(Curve=line_2, Length=number_slider_3)  # -> Points, Tangents, Parameters
# mesh planes that that go lengthwise of tower
xy_plane = XYPlane(Origin=divide_length.Points)
# mesh planes that contour tower
mesh_plane = MeshPlane(Mesh=twist, Plane=xy_plane)  # -> reverse(flatten(Curves))
move_to_plane = MoveToPlane(Geometry=mesh_plane, Plane=PlaneXY(0, 0, 0), Above=True, Below=True)  # -> Geometry, Transform
series = Series(Start=Slider(0, range=0..20), Step=Slider(6, range=0..20), Count=10)
unit_y = UnitY(Factor=series)
move = Move(Geometry=move_to_plane.Geometry, Motion=unit_y)  # -> Geometry, Transform
